# Dynamo custom node TrimbleExport.dyf (Dynamo 0.9.0.3067)
# category: MEP Tools
# Trimble Point Export

element = Input(element : Element)
parameterName = Input(parameterName : string)
code_block = CodeBlock { 0; }
getParameterValueByName = Element.GetParameterValueByName(element=element, parameterName=parameterName)
count = List.Count(getParameterValueByName)
code_block_2 = CodeBlock { 1; }
range = Range(start=code_block, end=count, step=code_block_2, lacing=Longest)
setParameterByName = Element.SetParameterByName(element=element, parameterName=parameterName, value=range)
Element = Output(setParameterByName)
filePath = Input(filePath : string)
sheetName = Input(sheetName : string)
number = DoubleInput(0)
number_2 = DoubleInput(0)
string = StringInput("NAME")
string_2 = StringInput("X( m )")
string_3 = StringInput("Y( m )")
string_4 = StringInput("Z( m )")
string_5 = StringInput("DESC")
string_6 = StringInput("ID")
headers = List.Create(string, string_2, string_3, string_4, string_5, string_6)
code_block_3 = CodeBlock { 6; }
chop = List.Chop(headers, code_block_3)
add = _ + _
parameterName_2 = Input(parameterName : string)
getParameterValueByName_2 = Element.GetParameterValueByName(element=element, parameterName=parameterName_2)
combine = List.Combine(add, getParameterValueByName_2, range)
location = FamilyInstance.Location(element)
watch = Watch(location)
X = Point.X(watch)
Y = Point.Y(watch)
Z = Point.Z(watch)
parameterName_3 = Input(parameterName : string)
getParameterValueByName_3 = Element.GetParameterValueByName(element=element, parameterName=parameterName_3)
id = Element.Id(element)
data = List.Create(combine, X, Y, Z, getParameterValueByName_3, id)
transpose = List.Transpose(data)
comb_header_data = List.Create(chop, transpose)
code_block_4 = CodeBlock { 1; }
flatten = List.Flatten(list=comb_header_data, amt=code_block_4)
writeToFile = Excel.WriteToFile(filePath=filePath, sheetName=sheetName, startRow=number, startCol=number_2, data=flatten)
data_2 = Output(writeToFile)  # "data"
