# Dynamo custom node TrimbleImport.dyf "Trimble.Import" (Dynamo 0.9.0.3067)
# category: MEP Tools
# Trimble Point Import

filePath = Input(filePath : string)
sheetName = Input(sheetName : string)
code_block = CodeBlock { 1; }
code_block_2 = CodeBlock { 5; }
familyType = Input(familyType : FamilyType)
fromPath = FileObject(filePath)  # "File.FromPath"
readFromFile = Excel.ReadFromFile(file=fromPath, sheetName=sheetName)
number = DoubleInput(1)
dropItems = List.DropItems(list=readFromFile, amount=number)
transpose = List.Transpose(dropItems)
prefix_w = List.Deconstruct(list=transpose)
X = List.Deconstruct(list=prefix_w.rest)
Y = List.Deconstruct(list=X.rest)
Z = List.Deconstruct(list=Y.rest)
byCoordinates = FamilyInstance.ByCoordinates(familyType, X.first, Y.first, Z.first)
id = Element.Id(byCoordinates)
writeToFile = Excel.WriteToFile(filePath=filePath, sheetName=sheetName, startRow=code_block, startCol=code_block_2, data=id)
data = Output(writeToFile)
code_block_3 = CodeBlock { 0; }
string = StringInput("ElementID")
writeToFile_2 = Excel.WriteToFile(filePath=filePath, sheetName=sheetName, startRow=code_block_3, startCol=code_block_2, data=string)
data_2 = Output(writeToFile_2)  # "data"
code_block_4 = CodeBlock { "Field Point Number Prefix"; }
separater0 = Input(separater0 : string[])
split = String.Split(prefix_w.first, separater0)
transpose_2 = List.Transpose(split)
prefix_w_o = List.Deconstruct(list=transpose_2)
setParameterByName = Element.SetParameterByName(element=byCoordinates, parameterName=code_block_4, value=prefix_w_o.first)
Element = Output(setParameterByName)
code_block_5 = CodeBlock { "Field Point Point Number"; }
number_2 = List.Deconstruct(list=prefix_w_o.rest)
toNumber = String.ToNumber(number_2.first)
setParameterByName_2 = Element.SetParameterByName(element=byCoordinates, parameterName=code_block_5, value=toNumber)
Element_2 = Output(setParameterByName_2)  # "Element"
code_block_6 = CodeBlock { "Field Point Description"; }
DESC = List.Deconstruct(list=Z.rest)
setParameterByName_3 = Element.SetParameterByName(element=byCoordinates, parameterName=code_block_6, value=DESC.first)
Element_3 = Output(setParameterByName_3)  # "Element"
rest = Output(DESC.rest)
rest_2 = Output(number_2.rest)  # "rest"
