# Dynamo graph place_coupling.dyn (Dynamo 2.3.0.5885)
# packages: Data-Shapes 2021.2.94, Rhythm 2021.1.1

code_block = CodeBlock { "Select Pipe"; }
categories = Categories("OST_PipeCurves")
selectmodelelements_data = Custom[SelectModelElements Data](InputName=code_block, CategoryFilter=categories)  # package Data-Shapes; Creates a Revit element selection input for UI.MultipleInputForm++ . Check out www.data-shapes.net for more infos!
boolean = BoolSelector(true)
multipleinputform = Custom[MultipleInputForm ++](Inputs=selectmodelelements_data, Toggle=boolean)  # package Data-Shapes; Create a form with multiple inputs. see www.data-shapes.net for tutorials and infos!
flatten = List.Flatten(list=multipleinputform.User_Inputs)
code_block_2 = CodeBlock { "Length"; }
ʳʰʸᵗʰᵐ_elements = Rhythm.Revit.Elements.Elements.GetParameterValueByNameCaSeiNSeNSiTiVe(element=multipleinputform.User_Inputs, parameterName=code_block_2)
flatten_2 = List.Flatten(list=ʳʰʸᵗʰᵐ_elements)
code_block_3 = CodeBlock { 6000; }
ge = flatten_2 >= code_block_3
filterByBoolMask = List.FilterByBoolMask(list=flatten, mask=ge)
getLocation = Element.GetLocation(element=filterByBoolMask.in)
code_block_4 = CodeBlock()
# ---------- code_block_4.designscript (5 lines) ----------
CouplingDictionary =
{"25.00":47,
"50.00":61,
"100.00":121,
"150.00":160};
# ----------------------------------------
code_block_5 = CodeBlock { "OUT = ['{:.2f}'.format(x) for x in IN[0]]"; }
code_block_6 = CodeBlock { "Diameter"; }
ʳʰʸᵗʰᵐ_elements_2 = Rhythm.Revit.Elements.Elements.GetParameterValueByNameCaSeiNSeNSiTiVe(element=filterByBoolMask.in, parameterName=code_block_6)
python_script_from_string = PythonStringNode(script=code_block_5, IN[0]=ʳʰʸᵗʰᵐ_elements_2)
valueAtKey = DesignScript.Builtin.Dictionary.ValueAtKey(dictionary=code_block_4, key=python_script_from_string)
code_block_7 = CodeBlock(y=code_block_3, x=valueAtKey) { y+x; }
length = Curve.Length(curve=getLocation)
code_block_8 = CodeBlock(segment=code_block_7, x=valueAtKey, length=length) { segment - (x/2)..length..segment; }
pointAtSegmentLength = Curve.PointAtSegmentLength(curve=getLocation, segmentLength=code_block_8)
python_script = Python(IN[0]=filterByBoolMask.in, IN[1]=pointAtSegmentLength)
# ---------- python_script.python (51 lines) ----------
import sys
import clr
clr.AddReference("RevitAPI")
clr.AddReference('ProtoGeometry')
from Autodesk.DesignScript.Geometry import *
clr.AddReference("RevitServices")
# import document manager
from RevitServices.Persistence import DocumentManager
# import transaction manager
from RevitServices.Transactions import TransactionManager
# instantiate current document
doc = DocumentManager.Instance.CurrentDBDocument
from Autodesk.Revit.DB.Plumbing.PlumbingUtils import BreakCurve
from Autodesk.Revit.DB import XYZ
#Get pipes and unwrap
pipes = UnwrapElement(IN[0])
points = IN[1]
printout = []
# start transaction
TransactionManager.Instance.EnsureInTransaction(doc)
for i, pipe in enumerate(pipes):
    for p in points[i]:
        #Point to XYZ and convert from mm to FEET
        point = XYZ((p.X/304.8), (p.Y/304.8), (p.Z/304.8))
        printout.append(p.X)
        printout.append(p.Y)
        printout.append(p.Z)
        printout.append(pipe.Id)
        printout.append(pipe.Location.Curve.GetEndPoint(0))
        printout.append(pipe.Location.Curve.GetEndPoint(1))
        newPipeId = BreakCurve(doc, pipe.Id, point)
        #Get new pipe
        newPipe = doc.GetElement(newPipeId)
        #Get new pipe connectors
        newPipeConnectors = newPipe.ConnectorManager.Connectors
        #Check
        connA = None
        connB = None
        for c in pipe.ConnectorManager.Connectors:
            pc = c.Origin
            #get connectorB near to connectorA
            nearest = [x for x in newPipeConnectors if pc.DistanceTo(x.Origin) < 0.01]
            #If exists asign
            if nearest:
                connA = c
                connB = nearest[0]
      	#doc Create fitting
		takeoff = doc.Create.NewUnionFitting(connA, connB)
# transaction done
TransactionManager.Instance.TransactionTaskDone()
OUT = printout
# ----------------------------------------
splitByPoints = Curve.SplitByPoints(curve=getLocation, points=pointAtSegmentLength)  # frozen
